vi "LTE Host eNodeB.gvi"   [LabVIEW Communications System Design Suite 2.0.1]
panel controls:
  "RIO Device": string = "RIO0"  # The RIO address of the RF hardware device
  "eNB TX Frequency [Hz]": f64 = 2000000000  # DL TX center frequency, allowed range depends on used RF device
  "eNB Max RF TX Power [dBm]": f64 = 10  # Maximum RF transmit output power (upper bound - achievable for a full scale complex sine wave (CW) signal) Note: The actual time-domain RF transmit power depends on the configured resource allocation and is typically at least 15dB lower to allow for the OFDM PAPR backoff.
  "UDP Receive Port": u16 = 50001  # The UDP port the host monitors for incoming packets to be transferred to the FPGA PDSCH chain.
  "Reference Clock Source": string = "Internal"  # Configures the Reference Clock source used for the transceiver chain. Internal: Device internal clock REF IN / ClkIn: Clock input at the RF device (i.e. rear connector pane at USRP RIO, front connector pane for NI 579x) PXI_CLK: Backplane clock from the PXI Chassis (NI 579x only) GPS: GPS module (NI USRP RIO 295x only)
  "stop": bool
  "eNB TX RF Port (USRP)": enum{"TX1/RF0", "TX1/RF1"} = "TX1/RF0"  # Selects the HW RF port where the DL TX is transmitted (USRP RIO only).
  "eNB RX Frequency [Hz]": f64 = 1800000000  # UL RX center frequency, allowed range depends on used RF device
  "symbol number for PUSCH constellation": u8 = 4  # The OFDM symbol number used for displaying constellation data for PUSCH IQ samples.
  "eNB RX RF Port (USRP)": enum{"RX2/RF0", "RX2/RF1"} = "RX2/RF1"  # Selects the HW RF port the UL RX will be received from (USRP RIO only)
  "eNB Transmitter": bool  # Enables or disables the transmitter using the current configuration.
  "eNB Receiver": bool  # Enables or disables the receiver using the current configuration.
  "eNB Manual Gain [dB]": f64  # Controls the analog RX gain in case eNB AGC is switched off.
  "eNB AGC": bool = TRUE  # Enables or disables the automated gain control on the receiver side. If enabled the analog RX gain of the RF device will be automatically configured within its valid range to meet a target range for the baseband receive power.
  "Rate Adaption": bool  # If enabled, eNB TX MCS is automatically adapted to reported/measured Wideband SINR [dB] to handle with channel quality fluctuations. The adaptation is calibrated so that the applied MCS produces about 5% to 10% BLER under current MCS conditions. If that is not desired, SINR Offset [dB] needs to be modified.
  "SINR Offset [dB]": f64 = 3  # This value is effectively subtracted from the reported SINR before looking up the MCS in the adaptation table (i.e. if a positive offset is configured, a higher reported SINR is required to adapt to a certain MCS to avoid block errors).
  "eNB TX UE Context": T2 = {"RNTI"=1, "Use UERS"=FALSE, "Antenna Port"=7, "CCE Offset"=0}
    # UE specific parameters for DL transmission.
    # USE UERS: If enabled, the DL transmitter feeds UE-specific reference signals into the PDSCH data stream. The usage of UERS is closely related to Transmission Mode 9 defined in the LTE standard 3GPP TS 36.213 §7.1.
    # RNTI: The radio network temporary identifier used for PDSCH scrambling and PDCCH CRC mask generation.
    # Antenna Port: The antenna port used for generating UERS, Range: 7…14 according to 3GPP TS 36.213 §7.1.
    # CCE Offset: First control channel element to be used for PDCCH transmission. According to 3GPP TS 36.211 §6.8.1/.2.
  "eNB RX UE Context": cluster{"RNTI": u16, "SRS Configuration": T3} = {1, TRUE, "0x200", TRUE}
    # UE-specific parameters for UL reception.
    # RNTI: The radio network temporary identifier used for PUSCH scrambling.
    # SRS Configuration: The configuration used for receiving sounding reference signals.
    # SRS Enabled: If TRUE, SRS location is reserved as last symbol in each UL subframe (FDD, TDD) and last 2 symbols in each special subframe (TDD) (according to 3GPP TS 36.211 §5.5.3.3: FDD: srs-SubframeConfig = 0, TDD: srs-SubframeConfig = 7).
    # SRS Subframe Allocation: Bitmap determining the subframes actually used for SRS transmission. Periodicity of 10, leftmost bit represents subframe 0.
    # Transmission Comb: Parameter transmissionComb k_TC determining if even (0) or odd (1) subcarriers are used for SRS transmission/reception. See also 3GPP TS 36.211 §5.5.3.2.
  "eNB TX Frame Structure": enum{"FDD", "TDD 5 5"} = "FDD"  # Select between frequency division duplex (FDD) and time division duplex (TDD) using subframe configuration 5 and special subframe configuration 5 (3GPP TS 36.211 §4)
  "eNB RX Frame Structure": enum{"FDD", "TDD 5 5"} = "FDD"  # Select between FDD (frequency division duplex) and TDD (time division duplex) using subframe configuration 5 and special subframe configuration 5 (3GPP TS 36.211 §4).
  "eNB RX Cell ID": u16  # The physical Cell ID used for PUSCH scrambling
  "eNB TX Cell ID": u16  # Physical cell ID used for PSS, CRS, UERS sequence generation and PDCCH/PDSCH scrambling. [0…511].
  "eNB TX DCI": T5 = {"Active"=TRUE, "MCS"="MCS 17 (64-QAM, rate ~0.43)", "Resource Block Allocation (4 PRB/bit)"=8388607}  # Downlink control information for the PDCCH content and the PDSCH transmission. MCS: Modulation and coding scheme used for PDSCH transmission according to 3GPP TS 36.213 §7.1.7 Active: Enables or Disables the transmission of PDCCH and PDSCH. Resource Block Allocation: Resource allocation given as bitmap with each bit representing four physical resource blocks (DL resource allocation type 0, 3GPP TS 36.213 §7.1.6.1). The left-most bit represents lowest resource block index.
  "eNB RX DCI": T5 = {"Active"=TRUE, "MCS"="MCS 9 (QPSK, rate ~0.66)", "Resource Block Allocation (4 PRB/bit)"=33554431}  # Parameters for reception of PUSCH. MCS: Modulation and coding scheme used for PUSCH reception according to 3GPP TS 36.213 §7.1.7. Active: Enables or disabled the reception of the PUSCH. Resource Block Allocation: Resource allocation for PUSCH given as bitmap with each bit representing 4 physical resource blocks (DL resource allocation type 0, 3GPP TS 36.312 §7.1.6.1). Leftmost bit represents lowest resource block index.
  "eNB Timing Offset": i32  # Changes the eNodeB timing (start of radio frame). Given in 30.72MS/s.
  "session": "LTE Host Session.gtype"
  "Command": string = "ns3.26-ni-lte-simple-optimized"  # Command to execute for external MAC
  "External MAC": bool = TRUE  # When enabled a program is executed on the RT described by command line and arguments. This switch applies for RT only. When disabled an internal basic MAC will be executed.
  "Arguments": string = "--numPackets=100 --simTime=120 --niApiDevMode=\"NIAPI_BS\" --niApiEnableLogging=\"true\" --niApiLteEnabled=\"true\" --niApiLteLoopbackEnabled=\"false\""  # Arguments to pass to the external MAC.
  "Stop on API Confirmation Errors": bool
  "Start Extern": bool  # When enabled a program is executed on the RT described by command line and arguments. This switch applies for RT only. When disabled an internal basic MAC will be executed.
  "Show Received Confirmations with external MAC enabled": bool = TRUE
panel indicators:
  "FPGA Ready": bool  # Signals that the FPGA bitfile has been downloaded and that the device has been initialized and is ready for configuration. (Initialization can take up to 20 seconds.).
  "eNB TX Active": bool  # Signals that all eNB TX control configurations have been applied and the transmitter is running.
  "eNB Coerced Max RF TX Power [dBm]": f64  # Indicates the coerced value actually used as maximum RF transmit output power level after applying the device’s capabilities (range and resolution limitations) to the configured eNB Maximum RF TX Power [dBm].
  "Data Transfer In": bool  # Indicates that the configured UDP stream is receiving data on the configured Receive Port.
  "Packet Loss In": bool  # Indicates that the system loses UDP data due to overload. Data inflow from UDP port is higher than configured PDSCH throughput.
  "eNB TX Power Spectrum": T1  # Shows the power spectrum of the DL TX baseband signal transferred to the RF.
  "eNB Coerced Gain [dB]": f64  # The actual used analog RX RF gain either set by AGC, if enabled, or by UE Manual Gain Value [dB]
  "eNB ADC Values Clipped": bool  # Indicates a numeric overflow at the ADC output. Overflows can be caused when the analog RX RF gain too high or the receive power level too high.
  "eNB Baseband RX Power [dBFS]": f64
  "eNB DDC Values Clipped": bool  # Indicates a numeric overflow at the output of the digital downconversion block Overflows can be caused when the analog RX RF gain too high or the receive power level too high.
  "eNB RX Power Spectrum": T1  # Shows the power spectrum of the UL RX baseband signal received from RF.
  "PUSCH Constellation": c128[]  # Constellation of RX IQ samples allocated for PUSCH transmission after equalization. Only samples for the configured OFDM Symbol-Nr (PUSCH) are displayed.
  "eNB Failure / Block Error Rate (BLER)": f64  # Graphical display of PUSCH reception block error rate.
  "eNB RX Active": bool  # Signals that all eNB RX control configurations have been applied and the receiver is running.
  "PUSCH Throughput [Mbps]": f64  # The achieved throughput on the PUSCH channel.
  "Radio Frame Number": u16  # The number of the latest successfully received report ranging from 0…1023.
  "Reported DL ACK/NACK": enum{"NACK", "ACK", "DTX"}[]  # Array showing the latest received DL ACK/NACK report from UE side.
  "Average DL error rate": f64
  "Reported DL Block Error Rate": f64  # Graphical and numerical representation of the DL receiver block error rate on the UE side reported back to the eNodeB.
  "TX starting": bool
  "eNB TX IFFT Output Clipped": bool  # Indicates a numeric overflow after the IFFT.
  "eNB RF RX Power [dBm]": f64
  "power calibration offset [dB]": f64
  "Reported Subband SINR [dB]": f64[]  # The reported SINR for each subband occupying 8 PRBs. Comparable to Reporting Mode 3-0 in 3GPP TS 36.213 §7.2.1. Usage of CRS or UERS for estimation depends on setting of Use UERS switch in UE RX System Parameters on the UE side
  "Reported WB SINR": f64  # The reported SINR over the full 20MHz band using cell specific reference signals.
  "eNB RF TX Power [dBm]": f64  # Actual eNB RF transmit power in dBm.
  "eNB Baseband TX Power [dBFS]": f64  # Actual eNB baseband transmit power level [baseband output power level] in dB full scale.
  "PUSCH BLER (current)": f64
  "eNB Applied Gain [dB]": f64
  "L1-L2 Interface active": bool
  "PHY Timing Indication Received": u32
  "TTI": u8
  "SFN": u16
  "Max MAC TX Delay": u32
  "Error Report": string
  "UL RX Indication CRC OK": bool
  "Evaluation Errors": u32
  "Negatives": u64
  "Tab": i32
  "device bandwidth [MHz]": u16
  "External MAC Output": string
  "IP Packets Size Exeeded Count": u32
  "Received Confirmations": T11
  "Status": string
  "Max Tim Ind in DMA": u32
  "Num Tim Ind Missed": u32
  "Tim Ind in DMA": u32
types:
  T1 = cluster{"f0": f64, "df": f64, "magnitude": f64[]}
  T2 = cluster{"RNTI": u16, "Use UERS": bool, "Antenna Port": UFXP(4.0), "CCE Offset": u8}
  T3 = cluster{"SRS Enabled": bool, "SRS Subframe Allocation": UFXP(10.0), "Transmission Comb": bool}
  T4 = enum{"MCS 0 (QPSK, rate ~0.12)", "MCS 1 (QPSK, rate ~0.15)", "MCS 2 (QPSK, rate ~0.19)", "MCS 3 (QPSK, rate ~0.25)", "MCS 4 (QPSK, rate ~0.30)", "MCS 5 (QPSK, rate ~0.37)", "MCS 6 (QPSK, rate ~0.44)", "MCS 7 (QPSK, rate ~0.51)", "MCS 8 (QPSK, rate ~0.59)", "MCS 9 (QPSK, rate ~0.66)", "MCS 10 (16-QAM, rate ~0.33)", "MCS 11 (16-QAM, rate ~0.37)", "MCS 12 (16-QAM, rate ~0.42)", "MCS 13 (16-QAM, rate ~0.48)", "MCS 14 (16-QAM, rate ~0.54)", "MCS 15 (16-QAM, rate ~0.60)", "MCS 16 (16-QAM, rate ~0.64)", "MCS 17 (64-QAM, rate ~0.43)", "MCS 18 (64-QAM, rate ~0.46)", "MCS 19 (64-QAM, rate ~0.50)", "MCS 20 (64-QAM, rate ~0.55)", "MCS 21 (64-QAM, rate ~0.60)", "MCS 22 (64-QAM, rate ~0.65)", "MCS 23 (64-QAM, rate ~0.70)", "MCS 24 (64-QAM, rate ~0.75)", "MCS 25 (64-QAM, rate ~0.80)", "MCS 26 (64-QAM, rate ~0.85)", "MCS 27 (64-QAM, rate ~0.89)", "MCS 28 (64-QAM, rate ~0.93)"}
  T5 = cluster{"Active": bool, "MCS": T4, "Resource Block Allocation (4 PRB/bit)": UFXP(25.0)}
  "LTE Transport Session.gtype" = cluster{"FIFO pathname": string, "pipe reader": "Pipe Reader.gtype", "pipe writer": "Pipe Writer.gtype", "transport in RT FIFO": RTFifoRefnum<u8[]>, "transport out RT FIFO": RTFifoRefnum<u8[]>, "transport in timing source name": string, "transport in timing trigger ID": u8, "transport out timing source name": string, "transport out timing trigger ID": u8, "maximum API message size": u32}
  "niInstr Register Bus v0 Host.lvlib__Register Bus Session.gtype" = Queue<"niInstr Register Bus v0 Host.lvlib__Session Data.gtype">
  "Semaphore RefNum.gtype" = i32
  "niUsrpRio Config v1 Host.lvlib__DB Queue Reference.gtype" = Queue<"niUsrpRio Config v1 Host.lvlib__Daughterboard Data.gtype">
  "niUsrpRio Config v1 Host.lvlib__niUsrpRio Session.gtype" = cluster{"FPGA Interface": any, "RIO Interface Number": u32, "Data Clock Rate": u32, "FPGA Data Clock Rate": u32, "Global Settings Register Bus": "niInstr Register Bus v0 Host.lvlib__Register Bus Session.gtype", "Radio 0 Settings Register Bus": "niInstr Register Bus v0 Host.lvlib__Register Bus Session.gtype", "Radio 1 Settings Register Bus": "niInstr Register Bus v0 Host.lvlib__Register Bus Session.gtype", "Radio Settings Bus Semaphore": "Semaphore RefNum.gtype", "DB Queues": "niUsrpRio Config v1 Host.lvlib__DB Queue Reference.gtype"[], "Characterization Data Valid?": bool, "EEPROM Header": "niUsrpRio Config v1 Host.lvlib__EEPROM Header.gtype", "Device Data Header": "niUsrpRio Config v1 Host.lvlib__EEPROM Device Data Header.gtype", "EEPROM Characterization Header": "niUsrpRio Config v1 Host.lvlib__EEPROM Characterization Header.gtype", "Characterization Data": "niUsrpRio Config v1 Host.lvlib__Characterization Data.gtype"[], "FPGA Current Version": u32, "FPGA Oldest Compatible Version": u32, "Fixed Logic Current Version": u32, "Fixed Logic Oldest Compatible Version": u32, "FPGA Radio Settings Bus Current Version": u32, "FPGA Radio Settings Bus Oldest Compatible Version": u32, "FPGA Board Config Current Version": u32, "FPGA Board Config Oldest Compatible Version": u32, "Daughterboard Clock Rate": u32}
  T6 = cluster{"FPGA ref": any, "bus instance": u32, "instruction FIFO depth": u32, "executing on FPGA target": bool, "show error call chain": bool}
  T7 = cluster{"Actual Gain [dB]": f64, "Attenuation Table Index": i32}
  T8 = cluster{"Attenuation Table [dB]": f64[][], "Frequencies [Hz]": f64[], "IQ Imbalance Table": "niUsrpRio Config v1 Host.lvlib__IQ Imbalance.gtype"[], "Gain Table": T7[][]}
  T9 = cluster{"FlexRIO Register Bus": Queue<T6>, "RX Characterization Data": T8, "TX Characterization Data": T8, "FPGA Interface": any}
  T10 = cluster{"transport block size": u32, "CRC ok": bool, "user data": u32}
  "LTE Host Session.gtype" = cluster{"target": enum{"USRP", "FlexRIO"}, "real time mode": bool, "MAC Stub enabled": bool, "DMA FIFO read timeout": i32, "timed loop period": i64, "LTE Transport Sessions": "LTE Transport Session.gtype"[], "USRP session": "niUsrpRio Config v1 Host.lvlib__niUsrpRio Session.gtype", "FlexRIO session": T9, "UDP RX session": UdpNetworkConnectionRefnum, "UDP TX session": UdpNetworkConnectionRefnum, "sync found queue": Queue<bool>, "PDCCH CRC ok queue": Queue<bool>, "DL PDCCH status queue": Queue<cluster{"CRC ok": bool, "subframe number": u32}>, "DL PDSCH status queue": Queue<cluster{"CRC ok": bool, "subframe number": u32}>, "DL SINR queue": Queue<f64[]>, "PDSCH user data queue": Queue<u32>, "PDSCH user data UDP queue": Queue<T10>, "PDSCH user data throughput queue": Queue<T10>, "PUSCH user data queue": Queue<u32>, "PUSCH user data UDP queue": Queue<T10>, "PUSCH user data throughput queue": Queue<T10>, "UE feedback info FIFO": RTFifoRefnum<u8[]>, "Request information FIFO": RTFifoRefnum<"LTE Request Information.gtype">, "UDP TX outbound FIFO": RTFifoRefnum<u8[]>, "UDP RX inbound FIFO": RTFifoRefnum<u8[]>, "stop notifier": Notifier<string>, "DL RX scope": string, "UL RX scope": string, "external MAC log file": string, "external MAC process ID": u32}
  "LTE Confirmation States.gtype" = enum{"Success", "Unknown Message", "Message not Supported", "Unknown Parameter (Set)", "Missing Parameter (Set)", "Parameter (Set) Repetition", "Range Violation", "State Violation", "Timeout", "Config Payload Mismatch", "Length Mismatch", "Input Buffer Full", "Internal Error", "Instance ID Mismatch"}
  T11 = cluster{"Element 1": "LTE Confirmation States.gtype"[], "Value": u64[]}
diagram:
  sequence {
    frame 0 {
      # Set Controls to default values
      $"L1-L2 Interface active" <- FALSE
      $"eNB Transmitter" <- FALSE
      $"eNB Receiver" <- FALSE
      $"FPGA Ready" <- FALSE
      $"eNB RX Active" <- FALSE
      $"eNB TX Active" <- FALSE
      $"TX starting" <- FALSE
      $"eNB TX Power Spectrum" <- T1 {all zero or empty}
      $"eNB RX Power Spectrum" <- T1 {all zero or empty}
      $"eNB Coerced Gain [dB]" <- 0
      $"eNB Coerced Max RF TX Power [dBm]" <- 0
      $"PUSCH Throughput [Mbps]" <- 0
      $"Reported WB SINR" <- 0
      $"Average DL error rate" <- 0
      $"eNB Failure / Block Error Rate (BLER)" <- 0
      $"Reported DL Block Error Rate" <- 0
      $"Reported Subband SINR [dB]" <- f64[] []
      $"PUSCH Constellation" <- c128[] []
      $"Radio Frame Number" <- 0
      $"Reported DL ACK/NACK" <- enum{"NACK", "ACK", "DTX"}[] []
      $"Error Report" <- ""
      $Status <- ""
    }
  }
  call "RT Startup Create Notifier.gvi"(Error In=no error) -> (Error Out=w1)
  # NI API CHANGE
  s1 = w1  # shift register
  while {
    Wait Until Next Multiple(multiple to wait=100)
    call "RT Startup Receive Notivication.gvi"(error in=s1) -> (error out=w2, notification=w3)
    $Status <- w3
    Is Equal(x=w3, y="System Init Complete!") -> w4
    next s1 = w2
    stop if w4
  }
  call "LTE eNodeB Host Initialization.gvi"(USRP device=$"RIO Device", session in=$session, error in=w1, reference clock source=$"Reference Clock Source", start externally=$"Start Extern", external MAC=$"External MAC", command=$Command, arguments=$Arguments) -> (error out=w5, session=w6, device bandwidth=w7)
  sequence {
    frame 0 {
      $session <- w6
      call "Display Error.gvi"(type of dialog="continue or stop message", error in=w5)
      $"L1-L2 Interface active" <- TRUE
    }
  }
  disable {
    frame TARGET_TYPE == "RT", Default {
      # Transport layer moves packets from L1 to MAC Stub implementation or external MAC
      call "LTE Transport.gvi"(session=w6, error in=w5) -> (error out=w9)
      call "LTE Get Transport Session.gvi"(Session=w6, Transport Session Select="Transport PHY Timing to MAC") -> (LTE Transport Session=w10, Session dup=w11)
      Property Node(instance in=w10) -> ("transport out timing source name"=w12)
      w13 = 100  # priority in
      # NI API CHANGE
      timed loop {
        Left Execution System Border Node(priority_in=w13, processor_in=1)
        Left Timing Statistics Border Node() -> (wakeupreason_out=w14)
        call "LTE Get Transport Session.gvi"(Session=w11, Transport Session Select="Transport PHY Timing to MAC") -> (LTE Transport Session=w15, Session dup=w16)
        Left Timing Error Border Node(error_in=w5) -> (error_out=w17)
        call "LTE Transport Read From Transport.gvi"(API transport session=w15, error in=w17, allow read fail=$"L1-L2 Interface active") -> (transport out=w18, transport read success=w19, error out=w20)
        case (w19) {
          frame False {
            w21 = w20
          }
          frame True {
            call "LTE PHY Receive Timing Indication.gvi"(api transport in=w18, error in=w20) -> (SFN=w22, TTI index=w23, error out=w24)
            call "LTE Check Subframe for Transmit.gvi"(frame structure=$"eNB TX Frame Structure", subframe index=w23, UL TX=FALSE, error in=w24) -> (allow DL transmit=w25, error out=w26)
            case (w25) {
              frame False, Default {
                w21 = w26
              }
              frame True {
                w27 = 200  # maximal execution time MPU assembly
                Property Node(instance in=w16) -> ("UDP TX outbound FIFO"=w28, instance out=w29)
                case ($"Rate Adaption") {
                  frame False, Default {
                    w30 = $"eNB TX DCI"
                    w31 = w26
                    w32 = $"eNB TX UE Context"
                    w33 = $"eNB TX Frame Structure"
                    w34 = w22
                    w35 = w23
                  }
                  frame True {
                    call "LTE MCS Regulation.gvi"(SNR offset [dB]=$"SINR Offset [dB]", wideband SNR=$"Reported WB SINR", DCI in=$"eNB TX DCI", UE context=$"eNB TX UE Context") -> (DCI out=w30)
                    $"eNB TX DCI" <- w30
                    w31 = w26
                    w32 = $"eNB TX UE Context"
                    w33 = $"eNB TX Frame Structure"
                    w34 = w22
                    w35 = w23
                  }
                }
                call "LTE MAC Prepare Tx Config.gvi"(SFN=w34, TTI index=w35, eNB TX UE Context=w32, eNB TX DCI=w30, frame structure=w33, error in=w31) -> (MAC TX Config=w36, error out=w37)
                call "LTE MAC PDU Assembly.gvi"(MAC TX config in=w36, error in=w37, data FIFO in=w28, maximal execution time=w27) -> (MAC PDU Size=w38, MAC PDU=w39, error out=w40, IP Packets size exceeded=w41, MAC TX config out=w42)
                Feedback Node(input=w43) -> w44
                Add(w41, w44) -> w43
                $"IP Packets Size Exeeded Count" <- w43
                call "LTE PHY TX Request Confirm Abstraction.gvi"(MAC TX Config=w42, MAC PDU Size=w38, MAC PDU=w39, Device Location="eNB", error in=w40) -> (api transport out=w45, error out=w46, requests=w47)
                Property Node(instance in=w29) -> ("Request information FIFO"=w48, instance out=w49)
                call "LTE MAC Enque Requests.gvi"(RT FIFO reference=w48, requests=w47, error in=w46) -> (error out=w50)
                call "LTE Get Transport Session.gvi"(Session=w49, Transport Session Select="Transport MAC to PHY") -> (LTE Transport Session=w51)
                call "LTE Transport Send To Transport.gvi"(API transport session=w51, transport in=w45, error in=w50) -> (error out=w21)
              }
            }
          }
        }
        Right Timing Error Border Node(error_in=w21) -> (error_out=w52)
        Left Timing Source Border Node[AlarmName=L, DefaultTimingSourceName="1 MHz", DefaultTimingSourceType=2](mode_in="Process missed periods, ignore original phase", period_in=1, source_in=w12, structure_in="MAC Stub Tx")
        continue if $"L1-L2 Interface active"
      }
      call "LTE Remove Timed Loop Abort Error.gvi"(error in=w52, wake up reason=w14) -> (error out=w53)
      call "Stop On Error.gvi"(error in=w53, error source prefix="MAC Stub Tx") -> (error out=w54)
      call "LTE Get Transport Session.gvi"(Session=w6, Transport Session Select="Transport PHY to MAC") -> (LTE Transport Session=w55, Session dup=w56)
      w57 = 98  # priority in
      # NI API CHANGE
      Property Node(instance in=w55) -> ("transport out timing source name"=w58)
      timed loop {
        Left Execution System Border Node(priority_in=w57, processor_in=2)
        Left Timing Statistics Border Node() -> (wakeupreason_out=w59)
        call "LTE Get Transport Session.gvi"(Session=w56, Transport Session Select="Transport PHY to MAC") -> (LTE Transport Session=w60, Session dup=w61)
        Left Timing Error Border Node(error_in=w5) -> (error_out=w62)
        call "LTE Transport Read From Transport.gvi"(API transport session=w60, error in=w62, allow read fail=$"L1-L2 Interface active") -> (transport out=w63, transport read success=w64, error out=w65)
        case (w64) {
          frame False {
            w66 = w65
          }
          frame True {
            call "LTE Decode General Message Header.gvi"(message data in=w63, error in=w65) -> (decoded general message header=w67, error out=w68)
            Property Node(instance in=w67) -> ("message type ID"=w69)
            case (w69) {
              frame 0, Default {
                call "Build Error Cluster.gvi"(code=-1, description="MAC Stub Rx: unexpected API message", error in=w68) -> (error out=w66)
              }
              frame 16898 {
                # PHY_CNF
                Property Node(instance in=w61) -> ("Request information FIFO"=w70)
                Not(x=$"Stop on API Confirmation Errors") -> w71
                call "LTE Handle DL TX Confirm.gvi"(RT FIFO reference=w70, api transport in=w63, error in=w68, clear confirmation errors=w71) -> (error out=w66, confirm received counts=w72, confirmation evaluation error count=w73, negative confirm received count=w74)
                $"Received Confirmations" <- w72
                $Negatives <- w74
                $"Evaluation Errors" <- w73
              }
              frame 17409 {
                call "LTE PHY Receive RX Indication.gvi"(api transport in=w63, expected device location="eNB", error in=w68) -> (MAC RX Config=w75, MAC PDU=w76, error out=w77)
                # PHY_ULSCH_RX_IND
                Property Node(instance in=w75) -> ("CRC Result"=w78)
                Is Greater Than 0(x=w78) -> w79
                case (w79) {
                  frame False, Default {
                    w66 = w77
                  }
                  frame True {
                    call "LTE Extract Payload.gvi"(transport block=w76) -> (payload=w80)
                    Feedback Node(initial value=u8[] [], input=w81) -> w82
                    Build Array[ConcatenateInputs=True](w82, w80) -> w83
                    call "LTE Align Feedback Data.gvi"(data in=w83) -> (remaining portion=w81, feedback payload=w84)
                    Is Empty Array(array=w84) -> w85
                    Not(x=w85) -> w86
                    case (w86) {
                      frame False, Default {
                        w66 = w77
                      }
                      frame True {
                        call "LTE Interpret PUSCH Payload.gvi"(PUSCH payload=w84) -> (radioframe number=w87, ACK/NACK=w88, subband SNR=w89, wideband SNR=w90)
                        $"Radio Frame Number" <- w87
                        $"Reported DL ACK/NACK" <- w88
                        To Double Precision Float(number=w89) -> w91
                        $"Reported Subband SINR [dB]" <- w91
                        To Double Precision Float(number=w90) -> w92
                        $"Reported WB SINR" <- w92
                        call "LTE Calculate Average Error Rate.gvi"(ACK/NACK=w88) -> (error rate=w93)
                        $"Average DL error rate" <- w93
                        Tick Count() -> (timer value=w94)
                        Feedback Node(input=w95) -> w96
                        Is Greater Or Equal(x=w94, y=w96) -> w97
                        case (w97) {
                          frame False, Default {
                            w95 = w96
                          }
                          frame True {
                            $"Reported DL Block Error Rate" <- w93
                            Add(w94, 1000) -> w95
                          }
                        }
                        w66 = w77
                      }
                    }
                  }
                }
                $"UL RX Indication CRC OK" <- w79
              }
            }
          }
        }
        Right Timing Error Border Node(error_in=w66) -> (error_out=w98)
        Left Timing Source Border Node[AlarmName=L, DefaultTimingSourceName="1 MHz", DefaultTimingSourceType=2](mode_in="Process missed periods, ignore original phase", period_in=1, source_in=w58, structure_in="MAC Stub Rx")
        continue if $"L1-L2 Interface active"
      }
      call "LTE Remove Timed Loop Abort Error.gvi"(error in=w98, wake up reason=w59) -> (error out=w99)
      call "Stop On Error.gvi"(error in=w99, error source prefix="MAC Stub Rx") -> (error out=w100)
      Property Node(instance in=w6) -> ("timed loop period"=w101, instance out=w102)
      w103 = 100  # priority in
      # NI API CHANGE
      timed loop {
        # receive PHY TTI timing indication (one per ms)
        Left Execution System Border Node(priority_in=w103, processor_in=1)
        Left Timing Statistics Border Node()
        Left Timing Error Border Node(error_in=w5) -> (error_out=w104)
        call "LTE Receive Timing Indication RT.gvi"(session=w102, error in=w104, eNB TX Active=$"eNB TX Active") -> (error out=w105, subframe index=w106, subframe index valid=w107, DMA max elements remaining=w108, Num Tim Ind Missed=w109, DMA elements remaining=w110)
        $"Num Tim Ind Missed" <- w109
        case (w107) {
          frame False {
            w111 = w105
            w112 = w107
            w113 = w102
          }
          frame True, Default {
            call "Get Time.gvi"(error in_2=w105) -> (tick count (us)=w114, error out_2=w115)
            call "LTE TTI Counter to SFN and TTI.gvi"(TTI counter=w106, error in=w115) -> (SFN=w116, TTI=w117, error out=w118)
            call "Counter U16 Dominant Increment.gvi"() -> (count out=w119)
            call "LTE Encode PHY SAP Timing Indication.gvi"(reference ID=w119, SFN=w116, TTI index=w117, error in=w118) -> (encoded PHY SAP Timing Indication=w120, error out=w121)
            call "LTE Get Transport Session.gvi"(Session=w102, Transport Session Select="Transport PHY Timing to MAC") -> (LTE Transport Session=w122, Session dup=w113)
            call "LTE Transport Send To Transport.gvi"(API transport session=w122, transport in=w120, error in=w121) -> (error out=w111)
            $SFN <- w116
            $TTI <- w117
            $"PHY Timing Indication Received" <- w114
            w112 = w107
          }
        }
        Logical And(w112, $"eNB RX Active") -> w123
        case (w123) {
          frame False, Default {
            w124 = w111
          }
          frame True {
            call "LTE Send Dynamic UL Configuration.gvi"(UE context=$"eNB RX UE Context", DCI=$"eNB RX DCI", scope="RX", session=w113, error in=w111) -> (error out=w124)
          }
        }
        Right Timing Error Border Node(error_in=w124) -> (error_out=w125)
        $"Tim Ind in DMA" <- w110
        Left Timing Source Border Node[AlarmName=L, DefaultTimingSourceName="1 MHz", DefaultTimingSourceType=2](mode_in="Discard missed periods, ignore original phase", period_in=w101, structure_in="PHY SAP Tim")
        $"Max Tim Ind in DMA" <- w108
        continue if $"L1-L2 Interface active"
      }
      call "Stop On Error.gvi"(error in=w125, error source prefix="PHY SAP Tim") -> (error out=w126)
      call "LTE Get Transport Session.gvi"(Session=w6, Transport Session Select="Transport MAC to PHY") -> (LTE Transport Session=w127, Session dup=w128)
      # NI API CHANGE
      w129 = 99  # priority in
      Property Node(instance in=w127) -> ("transport out timing source name"=w130)
      timed loop {
        Left Execution System Border Node(priority_in=w129, processor_in=1)
        # handover TX request to PHY FPGA
        Left Timing Statistics Border Node()
        call "LTE Get Transport Session.gvi"(Session=w128, Transport Session Select="Transport MAC to PHY") -> (LTE Transport Session=w131, Session dup=w132)
        Left Timing Error Border Node(error_in=w5) -> (error_out=w133)
        call "LTE Transport Read From Transport.gvi"(API transport session=w131, error in=w133, allow read fail=$"L1-L2 Interface active") -> (transport out=w134, transport read success=w135, error out=w136)
        call "Get Time.gvi"(error in=w136) -> (error out=w137, tick count (us)=w138)
        Subtract(x=w138, y=$"PHY Timing Indication Received") -> w139
        # reserve time buffer to transmit TX data to FPGA
        w140 = 700  # maximal allowed TX processing time [us]
        Is Greater(x=w139, y=w140) -> w141
        case (w135) {
          frame True {
            Property Node(instance in=$"eNB TX UE Context") -> ("Use UERS"=w144)
            call "LTE PHY TX Request Confirm Handler.gvi"(api transport in=w134, Expected SFN=$SFN, Expected TTI index=$TTI, Expected Device Location="eNB", error in=w137, frame structure=$"eNB TX Frame Structure", use UERS=w144, TX request too late=w141) -> (TX UE Context=w145, TX DCI=w146, TX Data=w147, error out=w148, api transport out=w149, output valid=w150)
            Logical And(w150, $"eNB TX Active") -> w143
            Property Node(instance in=w132) -> ("MAC Stub enabled"=w151, instance out=w152)
            case (w143) {
              frame False, Default {
                w153 = w148
                w154 = w152
              }
              frame True {
                call "LTE Send Dynamic DL TX Configuration.gvi"(DCI in=w146, UE context=w145, session=w152, error in=w148) -> (error out=w155, session dup=w156)
                call "LTE Send Dynamic DL Tx Payload.gvi"(session in=w156, TX data=w147, error in=w155) -> (error out=w153, session out=w154)
                case (w151) {
                  frame True { }
                  frame False {
                    # NI API CHANGE
                    $"eNB TX DCI" <- w146
                  }
                }
              }
            }
            Property Node(instance in=w154) -> ("Request information FIFO"=w157, "MAC Stub enabled"=w158)
            Array Size(array=w149) -> (size(s)=w159)
            Is Greater Than 0(x=w159) -> w160
            Logical And(not w158, $"Show Received Confirmations with external MAC enabled") -> w161
            case (w160) {
              frame False, Default {
                call "Build Error Cluster.gvi"(code=-1, description="Confirmation message response is empty.", error in=w153) -> (error out=w142)
              }
              frame True {
                call "LTE Get Transport Session.gvi"(Session=w154, Transport Session Select="Transport PHY to MAC") -> (LTE Transport Session=w162)
                call "LTE Transport Send To Transport.gvi"(API transport session=w162, transport in=w149, error in=w153) -> (error out=w142)
                case (w161) {
                  frame False { }
                  frame True {
                    # NI API CHANGE
                    call "LTE Handle DL TX Confirm.gvi"(RT FIFO reference=w157, api transport in=w149, clear confirmation errors=TRUE) -> (confirm received counts=w163, negative confirm received count=w164)
                    $"Received Confirmations" <- w163
                    $Negatives <- w164
                  }
                }
              }
            }
          }
          frame False {
            w142 = w137
            w143 = w135
          }
        }
        call "Get Time.gvi"(error in=w142) -> (error out=w165, tick count (us)=w166)
        Right Timing Error Border Node(error_in=w165) -> (error_out=w167)
        case (w143) {
          frame True {
            Subtract(x=w166, y=$"PHY Timing Indication Received") -> w168
            call "Get and Hold Maximum.gvi"(value=w168) -> (max value=w169)
            $"Max MAC TX Delay" <- w169
          }
          frame False { }
        }
        Left Timing Source Border Node[AlarmName=L, DefaultTimingSourceName="1 MHz", DefaultTimingSourceType=2](mode_in="Process missed periods, ignore original phase", period_in=1, source_in=w130, structure_in="PHY SAP Tx")
        continue if $"L1-L2 Interface active"
      }
      call "Stop On Error.gvi"(error in=w167, error source prefix="PHY SAP Tx") -> (error out=w170)
      w171 = 98  # priority in
      # NI API CHANGE
      Property Node(instance in=w6) -> ("timed loop period"=w172, instance out=w173)
      timed loop {
        Left Execution System Border Node(priority_in=w171, processor_in=2)
        Left Timing Statistics Border Node()
        Left Timing Error Border Node(error_in=w5) -> (error_out=w174)
        call "LTE Receice PUSCH Decoding Status.gvi"(session=w173, error in=w174) -> (PUSCH Decoding Status valid=w175, PUSCH Decoding Status=w176, error out=w177)
        case (w175) {
          frame False, Default {
            w178 = w177
          }
          frame True {
            Property Node(instance in=w173) -> ("PUSCH user data throughput queue"=w179, instance out=w180)
            call "LTE PDSCH Channel Decoder Status from U32.gvi"(bit vector in=w176, valid in=TRUE) -> (PDSCH decoder status=w181)
            Property Node(instance in=w181) -> ("user data"=w182, "transport block size"=w183, "CRC ok"=w184, instance out=w185)
            Enqueue Element(element=w185, error in=w177, queue=w179, timeout in ms=0) -> (error out=w186)
            call "LTE Receive PUSCH MAC PDU.gvi"(session=w180, transport block size=w183, error in=w186) -> (MAC PDU=w187, error out=w188)
            call "LTE Get Transport Session.gvi"(Session=w180, Transport Session Select="Transport PHY to MAC") -> (LTE Transport Session=w189)
            Boolean To Integer(Boolean=w184) -> (0, 1=w190)
            To Unsigned Byte Integer(number=w190) -> w191
            Array Size(array=w187) -> (size(s)=w192)
            To Unsigned Long Integer(number=w192) -> w193
            To Unsigned Byte Integer(number=w182) -> w194
            call "Counter U16 Dominant Increment.gvi"() -> (count out=w195)
            Property Node(instance in=$"eNB RX UE Context") -> ("RNTI"=w196)
            call "LTE Encode PHY SAP UL RX Indication.gvi"(reference ID=w195, SFN=0, TTI index=w194, MAC PDU=w187, MAC PDU Size=w193, RNTI=w196, CRC Result=w191) -> (encoded UL RX Indication=w197)
            call "LTE Transport Send To Transport.gvi"(API transport session=w189, transport in=w197, error in=w188) -> (error out=w178)
          }
        }
        Right Timing Error Border Node(error_in=w178) -> (error_out=w198)
        Left Timing Source Border Node[AlarmName=L, DefaultTimingSourceName="1 MHz", DefaultTimingSourceType=2](mode_in="Discard missed periods, ignore original phase", period_in=w172, structure_in="PHY SAP Rx")
        continue if $"L1-L2 Interface active"
      }
      call "Stop On Error.gvi"(error in=w198, error source prefix="PHY SAP Rx") -> (error out=w199)
      s2 = w5  # shift register
      while {
        Wait(time to wait=1)
        Property Node(instance in=$session) -> ("UDP TX outbound FIFO"=w200, "UDP TX session"=w201)
        s3 = s2  # shift register
        while {
          Udp Read I Pv 6 Binary(connection ID=w201, error in=s3, max size=10240, timeout ms=0) -> (data out=w204, error out=w205)
          call "Filter Error Codes.gvi"(codes to clear=[1, 113, 66, 56], error in=w205) -> (codes cleared=w206, error cleared?=w207, error out=w208)
          Search 1D Array(1D array=w206, element=113) -> (index of element=w209)
          Is Greater Or Equal To 0(x=w209) -> w210
          Search 1D Array(1D array=w206, element=56) -> (index of element=w211)
          Is Greater Or Equal To 0(x=w211) -> w212
          Not(x=w212) -> w213
          Is Empty Array(array=w204) -> w214
          Not(x=w214) -> w215
          Logical And(w213, w215) -> w216
          case (w207) {
            frame True {
              w217 = w208
            }
            frame False {
              RTFIFO Write(element=w204, error in=w208, overwrite on timeout=TRUE, rt fifo=w200, timeout in ms=0) -> (error out=w217)
            }
          }
          call "Is Error.gvi"(error in=w217) -> (is error?=w218)
          Logical Or(w218, w207, w214) -> w219
          append w210 to w202
          append w216 to w203
          next s3 = w217
          stop if w219
        }
        Or Array Elements(Boolean array=w202) -> (logical OR=w220)
        $"Packet Loss In" <- w220
        Or Array Elements(Boolean array=w203) -> (logical OR=w221)
        $"Data Transfer In" <- w221
        call "Check Stop.gvi"(error in=s3) -> (error out=w222, stop=w223)
        next s2 = w222
        stop if w223
      }
      call "Stop On Error.gvi"(error in=s2) -> (error out=w224)
      Build Array[ConcatenateInputs=True](w54, w100, w9, w126, w170, w199, w224) -> w8
    }
    frame TARGET_TYPE != "RT" {
      s4 = w5  # shift register
      s5 = 0  # shift register
      while {
        Wait Until Next Multiple(multiple to wait=100)
        call "LTE Read UL Data.gvi"(session=$session, error in=s4) -> (error out=w225, radioframe number=w226, output valid=w227, DL ACK/NACK=w228, subband SNR=w229, wideband SNR=w230)
        # read and decode PUSCH feedback information
        # use feedback information to apply correct MCS
        # 5
        case (w227) {
          frame False, Default {
            w231 = s5
            w232 = w225
          }
          frame True {
            $"Radio Frame Number" <- w226
            $"Reported DL ACK/NACK" <- w228
            To Double Precision Float(number=w229) -> w233
            $"Reported Subband SINR [dB]" <- w233
            To Double Precision Float(number=w230) -> w234
            $"Reported WB SINR" <- w234
            call "LTE Calculate Average Error Rate.gvi"(ACK/NACK=w228) -> (error rate=w235)
            $"Average DL error rate" <- w235
            Increment(x=s5) -> w231
            Quotient And Remainder(x=w231, y=10) -> (x-y*floor(x/y)=w236)
            Is Equal To 0(x=w236) -> w237
            case (w237) {
              frame False, Default { }
              frame True {
                $"Reported DL Block Error Rate" <- w235
              }
            }
            w232 = w225
          }
        }
        call "Check Stop.gvi"(error in=w232) -> (error out=w238, stop=w239)
        next s4 = w238
        next s5 = w231
        stop if w239
      }
      call "Stop On Error.gvi"(error in=s4) -> (error out=w240)
      s6 = w5  # shift register
      while {
        # use SINR information to apply correct MCS
        case ($"eNB TX Active") {
          frame False, Default {
            Wait(time to wait=10)
            w241 = s6
            w242 = TRUE
          }
          frame True {
            call "LTE Receive Timing Indication.gvi"(session=$session, error in=s6) -> (session dup=w243, error out=w244, new timing indication=w242)
            case (w242) {
              frame False, Default {
                w241 = w244
              }
              frame True {
                case ($"Rate Adaption") {
                  frame False, Default {
                    w245 = $"eNB TX DCI"
                    w246 = w244
                  }
                  frame True {
                    call "LTE MCS Regulation.gvi"(SNR offset [dB]=$"SINR Offset [dB]", wideband SNR=$"Reported WB SINR", DCI in=$"eNB TX DCI", UE context=$"eNB TX UE Context") -> (DCI out=w245)
                    w246 = w244
                  }
                }
                call "LTE Send Dynamic DL TX Configuration.gvi"(DCI in=w245, UE context=$"eNB TX UE Context", session=w243, error in=w246) -> (error out=w241, coerced DCI=w247, DCI modified=w248)
                case (w248) {
                  frame False, Default { }
                  frame True {
                    $"eNB TX DCI" <- w247
                  }
                }
              }
            }
          }
        }
        Logical And(w242, $"eNB RX Active") -> w249
        # 5
        case (w249) {
          frame False, Default {
            w250 = w241
          }
          frame True {
            call "LTE Send Dynamic UL Configuration.gvi"(UE context=$"eNB RX UE Context", DCI=$"eNB RX DCI", scope="RX", session=$session, error in=w241) -> (error out=w250)
          }
        }
        call "Check Stop.gvi"(error in=w250) -> (error out=w251, stop=w252)
        next s6 = w251
        stop if w252
      }
      call "Stop On Error.gvi"(error in=s6) -> (error out=w253)
      s7 = w5  # shift register
      s8 = 0  # shift register
      while {
        # receive UDP data from network and send it to the FPGA as PDSCH payload data of the transmitter
        # read received PDSCH payload data from FPGA and send it to the specified UDP port
        Wait Until Next Multiple(multiple to wait=0)
        call "LTE Receive UDP Data.gvi"(session=$session, eNB TX active=$"eNB TX Active", UDP packet counter in=s8, error in=s7) -> (FIFO full=w254, data transfer=w255, UDP packet counter out=w256, error out=w257)
        $"Packet Loss In" <- w254
        $"Data Transfer In" <- w255
        # 6
        call "Check Stop.gvi"(error in=w257) -> (error out=w258, stop=w259)
        next s7 = w258
        next s8 = w256
        stop if w259
      }
      call "Stop On Error.gvi"(error in=s7) -> (error out=w260)
      Build Array(w240, w253, w260) -> w8
    }
  }
  s9 = w5  # shift register
  while {
    Wait Until Next Multiple(multiple to wait=100)
    Feedback Node[DelayCount=3](input=w261) -> w262
    call "LTE Determine Configuration Trigger.gvi"(RX enabled=$"eNB Receiver", TX enabled=$"eNB Transmitter") -> (trigger RX configuration=w263, trigger TX configuration=w264)
    # configure eNB RX/TX baseband and RF when enabled
    case (w263) {
      frame False, Default {
        w265 = s9
      }
      frame True {
        case ($"eNB Receiver") {
          frame False, Default {
            call "LTE Disable UL RX.gvi"(session=$session, error in=s9) -> (error out=w265)
            sequence {
              frame 0 {
                $"eNB RX Active" <- FALSE
              }
            }
          }
          frame True {
            Property Node(instance in=$session) -> ("real time mode"=w266)
            call "LTE Setup UL RX Baseband.gvi"(frame structure=$"eNB RX Frame Structure", session in=$session, error in=s9, cell ID=$"eNB RX Cell ID", RF timing offset=$"eNB Timing Offset", UE Context=$"eNB RX UE Context", DCI=$"eNB RX DCI", real time mode=w266) -> (error out=w267, session dup=w268)
            call "LTE Setup RX.gvi"(session in=w268, RX port=$"eNB RX RF Port (USRP)", error in=w267, RX frequency [Hz]=$"eNB RX Frequency [Hz]", gain value [dB]=$"eNB Coerced Gain [dB]", LTE scope="UL") -> (session out=w269, coerced gain [dB]=w270, error out=w271, coerced frequency [Hz]=w272)
            $session <- w269
            $"eNB Coerced Gain [dB]" <- w270
            $"eNB RX Frequency [Hz]" <- w272
            case (w271) {
              frame Error {
                $"eNB Receiver" <- FALSE
                w265 = w271
              }
              frame No Error {
                $"eNB RX Active" <- TRUE
                w265 = w271
              }
            }
          }
        }
      }
    }
    # 1
    case (w264) {
      frame False, Default {
        w273 = s9
      }
      frame True {
        case ($"eNB Transmitter") {
          frame False, Default {
            sequence {
              frame 0 {
                $"eNB TX Active" <- FALSE
              }
              frame 1 {
                Wait(time to wait=10)
              }
            }
            call "LTE Disable DL TX.gvi"(session=$session, error in=s9) -> (error out=w273)
          }
          frame True {
            case (s9) {
              frame Error {
                w274 = s9
              }
              frame No Error {
                $"TX starting" <- TRUE
                w274 = s9
              }
            }
            Property Node(instance in=$session) -> ("real time mode"=w275)
            call "LTE Setup DL TX Baseband.gvi"(session in=$session, UDP receive port=$"UDP Receive Port", frame structure=$"eNB TX Frame Structure", cell ID=$"eNB TX Cell ID", UE context=$"eNB TX UE Context", error in=w274, DCI=$"eNB TX DCI", real time mode=w275) -> (session out=w276, error out=w277)
            call "LTE Setup TX.gvi"(session in=w276, TX frequency [Hz]=$"eNB TX Frequency [Hz]", TX power level [dB]=$"eNB Max RF TX Power [dBm]", TX port=$"eNB TX RF Port (USRP)", error in=w277, LTE scope="DL", timing advance=0) -> (coerced output power [dB]=w278, error out=w279, session dup=w280, coerced frequency [Hz]=w281, coerced power level setting [dB]=w282)
            $session <- w280
            $"eNB Coerced Max RF TX Power [dBm]" <- w278
            case (w279) {
              frame No Error, Default {
                $"eNB TX Active" <- TRUE
                $"TX starting" <- FALSE
                call "LTE Setup DL TX Set Active.gvi"(session in=w280, error in=w279) -> (error out=w273)
              }
              frame Error {
                $"eNB Transmitter" <- FALSE
                $"TX starting" <- FALSE
                call "LTE Check UDP Port In Use.gvi"(error in=w279) -> (error out=w273)
              }
            }
            $"eNB TX Frequency [Hz]" <- w281
            $"eNB Max RF TX Power [dBm]" <- w282
          }
        }
      }
    }
    Merge Errors(w265, w273) -> (error out=w283)
    # synchronize the exit condition across all loops of the host application
    call "Create Stop.gvi"(error in=w283, stop in=$stop) -> (error out=w284)
    call "Check Stop.gvi"(error in=w284) -> (error out=w285, stop=w261)
    # Disable TX and RX to
    # ensure proper shutdown
    Not(x=w261) -> w286
    $"L1-L2 Interface active" <- w286
    case (w261) {
      frame False, Default { }
      frame True {
        $"eNB Receiver" <- FALSE
        $"eNB Transmitter" <- FALSE
      }
    }
    case (s9) {
      frame Error { }
      frame No Error {
        $"FPGA Ready" <- TRUE
      }
    }
    next s9 = w285
    stop if w262
  }
  call "Stop On Error.gvi"(error in=s9) -> (error out=w287)
  s10 = w5  # shift register
  while (iteration -> i1) {
    Wait Until Next Multiple(multiple to wait=50)
    disable {
      frame TARGET_TYPE == "RT", Default {
        w288 = $session
        w289 = s10
      }
      frame TARGET_TYPE != "RT" {
        call "LTE Read PUSCH Decoder Status.gvi"(session in=$session, error in=s10) -> (error out=w289, session dup=w288)
      }
    }
    call "LTE Get ADC and IFFT Status.gvi"(session in=w288, error in=w289) -> (ADC values clipped=w290, error out=w291, TX IFFT output clipped=w292, RX DDC values clipped=w293, session dup=w294)
    call "LTE Read UL BB Power.gvi"(error in=w291, session in=w294) -> (session dup=w295, error out=w296, RX baseband input power=w297)
    call "LTE Read TX BB Power.gvi"(error in=w296, session in=w295, TX reference level [dBm]=$"eNB Coerced Max RF TX Power [dBm]", LTE scope="DL") -> (session dup=w298, error out=w299, TX power [dBm]=w300, TX baseband power [dBFS]=w301)
    call "LTE Calculate Power Calibration Offset.gvi"(session in=w298, frequency [Hz]=$"eNB RX Frequency [Hz]", error in=w299, LTE scope="UL") -> (session dup=w302, power calibration offset [dB]=w303, error out=w304)
    $"power calibration offset [dB]" <- w303
    Not(x=$"eNB AGC") -> w305
    call "LTE Control Power Gain.gvi"(expected signal range lower bound=-17, use manual gain=w305, BB input power=w297, gain in=$"eNB Coerced Gain [dB]", manual gain value [dB]=$"eNB Manual Gain [dB]", expected signal range upper bound=-15, power calibration offset [dB]=w303) -> (RF input power [dBm]=w306, power [dBFS]=w307, gain out=w308)
    # read sync status and baseband power levels from FPGA and feed them into automatic gain control (AGC)
    # use manual gain value if AGC is disabled
    # configure frequency offset on FPGA
    # read PUSCH decoder status
    Logical And(not $"TX starting", $"eNB Receiver", $"eNB RX Active") -> w309
    # 2
    case (w309) {
      frame False, Default {
        w310 = w304
      }
      frame True {
        call "LTE Apply AGC Output.gvi"(session=w302, LTE scope="UL", error in=w304, apply values=w309, AGC output=w308) -> (coerced gain [dB]=w311, error out=w310)
        $"eNB Coerced Gain [dB]" <- w311
      }
    }
    call "Check Stop.gvi"(error in=w310) -> (error out=w312, stop=w313)
    $"eNB RF TX Power [dBm]" <- w300
    $"eNB Baseband TX Power [dBFS]" <- w301
    $"eNB Baseband RX Power [dBFS]" <- w307
    $"eNB RF RX Power [dBm]" <- w306
    $"eNB Applied Gain [dB]" <- $"eNB Coerced Gain [dB]"
    $"eNB ADC Values Clipped" <- w290
    $"eNB TX IFFT Output Clipped" <- w292
    To Unsigned Long Integer(number=i1) -> w314
    Quotient And Remainder(x=w314, y=10) -> (x-y*floor(x/y)=w315)
    Is Equal To 0(x=w315) -> w316
    Logical Or(w293, w316) -> w317
    Feedback Node(enable?=w317, input=w293) -> w318
    Feedback Node(enable?=w316, input=w318) -> w319
    $"eNB DDC Values Clipped" <- w319
    next s10 = w312
    stop if w313
  }
  call "Stop On Error.gvi"(error in=s10) -> (error out=w320)
  s11 = w5  # shift register
  while (iteration -> i2) {
    Wait Until Next Multiple(multiple to wait=20)
    # NI API CHANGE
    Quotient And Remainder(x=i2, y=5) -> (x-y*floor(x/y)=w321)
    Select(s=$"External MAC", t=3, f=w321) -> w322
    # read RX/TX baseband data values and PDCCH/PDSCH constellation data from FPGA and draw corresponding diagrams
    # 3
    case (w322) {
      frame 0, Default {
        call "LTE Read TX Data.gvi"(session=$session, error in=s11) -> (error out=w324, TX baseband data=w325)
        call "LTE Calculate TX Power Spectrum.gvi"(TX data=w325, error in=w324, coerced gain [dB]=$"eNB Coerced Max RF TX Power [dBm]") -> (TX power spectrum=w326, error out=w323)
        $"eNB TX Power Spectrum" <- w326
      }
      frame 1 {
        call "LTE Read RX Data.gvi"(session=$session, error in=s11) -> (RX data=w327, error out=w328)
        call "LTE Calculate RX Power Spectrum.gvi"(RX data=w327, coerced gain [dB]=$"eNB Coerced Gain [dB]", error in=w328, power calibration offset [dB]=$"power calibration offset [dB]") -> (RX power spectrum=w329, error out=w323)
        $"eNB RX Power Spectrum" <- w329
      }
      frame 2 {
        call "LTE Read Constellation Data.gvi"(session=$session, error in=s11, symbol number for display=$"symbol number for PUSCH constellation", RX tab=-1) -> (constellation data=w330, display data out=w331, error out=w323)
        case (w331) {
          frame False, Default { }
          frame True {
            $"PUSCH Constellation" <- w330
          }
        }
      }
      frame 3 {
        case ($"External MAC") {
          frame False, Default {
            w323 = s11
          }
          frame True {
            call "LTE Read External MAC Output.gvi"(session=$session, error in=s11, full log=FALSE) -> (external MAC log output=w332, error out=w323)
            $"External MAC Output" <- w332
          }
        }
      }
      frame 4 {
        w323 = s11
      }
    }
    call "Check Stop.gvi"(error in=w323) -> (error out=w333, stop=w334)
    next s11 = w333
    stop if w334
  }
  sequence {
    frame 0 {
      # NI API CHANGE
      call "LTE Read External MAC Output.gvi"(session=$session, error in=s11, full log=TRUE) -> (external MAC log output=w335, error out=w336)
      $"External MAC Output" <- w335
    }
  }
  call "Stop On Error.gvi"(error in=w336) -> (error out=w337)
  s12 = 0  # shift register
  s13 = w5  # shift register
  while {
    Wait Until Next Multiple(multiple to wait=1000)
    # compute throughput and block error rate and draw corresponding diagrams
    Tick Count() -> (timer value=w338)
    Subtract(x=w338, y=s12) -> w339
    call "LTE Calculate UL Throughput and BLER.gvi"(time difference=w339, session=$session, error in=s13) -> (UL throughput (current)=w340, error out=w341, UL BLER=w342)
    # 4
    case ($"eNB RX Active") {
      frame False, Default { }
      frame True {
        $"PUSCH Throughput [Mbps]" <- w340
        $"eNB Failure / Block Error Rate (BLER)" <- w342
        $"PUSCH BLER (current)" <- w342
      }
    }
    call "Check Stop.gvi"(error in=w341) -> (error out=w343, stop=w344)
    next s12 = w338
    next s13 = w343
    stop if w344
  }
  call "Stop On Error.gvi"(error in=s13) -> (error out=w345)
  Build Array[ConcatenateInputs=True](w287, w320, w337, w345, w8) -> w346
  sequence (after w346) {
    frame 0 {
      # NI API CHANGE
      call "RT Startup Send Notification.gvi"(Error In=s1, Notification="System Stopped!") -> (Error Out=w347)
      call "RT Startup Destroy Notifier.gvi"(error in=w347)
    }
  }
  # NI API CHANGE
  call "LTE Read External MAC Output.gvi"(session=w6, full log=TRUE) -> (external MAC log output=w348)
  $"External MAC Output" <- w348
  sequence {
    frame 0 {
      call "LTE eNodeB Host Cleanup.gvi"(session=$session, error in=no error) -> (error out=w349)
      Build Array[ConcatenateInputs=True](w346, w349) -> w350
      $"FPGA Ready" <- FALSE
    }
  }
  call "LTE Generate Error Report.gvi"(error in=w350) -> (error report=w351, error occured=w352)
  $"Error Report" <- w351
  case (w352) {
    frame False, Default { }
    frame True {
      # Switch to status tab
      # in case of error
      $Tab <- 2
    }
  }
  $"device bandwidth [MHz]" <- w7
